# Grasshopper definition robot programm2.gh (Grasshopper 1.0.8)
# plug-ins: RhinoCodePluginGH, Heteroptera, Robots

move_z_togeter = Slider(0, range=0..700)
save = Button()

cut_hight = Slider(139, range=3..200)
cut_lower = Slider(22, range=-200..200)

prepare_long = Panel("970")
cutting_long = Panel("1010")

# ---- group: RealTime_Feedback
# Real TCP Plane_Calibration
list = RobotsLibrary({"DDU-IRB120", "DDU-UR10-Fred", "DDU-UR10-Ginger"}, selected="DDU-UR10-Fred", Type=0)
get_realtime_tcp = BooleanToggle(False)
realtime_feedback = RealTimeFeedback(robot_name=list, getdata=get_realtime_tcp)
pln = Plane(realtime_feedback)

# ----
cutting_based_on = ValueList({"surface": 0, "line": 1}, selected="line")

unit_z = UnitZ(Factor=1)

surface = Surface(pln)
cluster = Cluster_8(surface=surface)

center = Center(Geometry=<missing>)  # -> Center, Dimension
Z = UnitZ(Factor=move_z_togeter)
Z_2 = UnitZ(Factor=move_z_togeter)

subtraction = Subtraction(A=cutting_long, B=prepare_long)
division = Division(A=subtraction, B=2)

pulsedo = PulseDO(DO=Slider(1, range=0..2), Time=0.2)
groupcmd = GroupCommand(Commands=pulsedo)

speed = CreateSpeed(
    Translation=Slider(25, range=0..100),
    Rotation=3.141592654,
    ExternalTranslation=5000,
    ExternalRotation=18.84955592,
    AccelTranslation=2500,
    AccelAxis=12.56637061)

upload = Button()
pause = Button()
play = Button()

robot = ValueList({"GINGER": 0, "FRED": 1}, selected="FRED")
robot_2 = ValueList({"GINGER": 0, "FRED": 1}, selected="GINGER")
fred_or_ginger = FredOrGinger(G=robot)
fred_or_ginger_2 = FredOrGinger_2(G=robot_2)

# ----
# Basic settings
value_list = ValueList({"One": 0, "Two": 1}, selected="One")
base_curve = Curve(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)
panel = Panel("22")

cluster_2 = Cluster_13(G=base_curve, F_2="-200", F=cut_lower)

cluster_3 = Cluster_5(curve=cluster_2, factor=cut_hight, gate=value_list, length=expr("x/2", cutting_long))  # -> point_2, curves

point = Point(cluster_3.point_2)
curve = Curve(cluster_3.curves)

# ----
# Cutting Angle
cluster_4 = Cluster_6(geometry=curve, center=point, axis=unit_z, gate=value_list, _0=Slider(10, range=0..360))

# ----
# Saw movement distance
number_slider = Slider(0.05, range=0..0.25)
cluster_5 = Cluster_11(curve=cluster_4, value=cut_hight, B=number_slider)
curve_2 = Curve(cluster_5)

# ----
# IF   Face-based cutting
surface_2 = Surface(<surface referenced from the Rhino model>)
cluster_6 = Cluster_15(surface=surface_2, curve=curve)
cluster_7 = Cluster_16(list=cluster_6, relay=number_slider)
curve_3 = Curve(cluster_7)

stream_filter = StreamFilter(Gate=cutting_based_on, Stream0=curve_3, Stream1=curve_2)
curve_4 = Curve(stream_filter)

custom_preview = CustomPreview(Geometry=curve_4, Material=ColourSwatch(SwatchColor=RGB(255, 215, 205)))

# ----
# Robot TCP control
axis_line = Slider(90, range=0..360)
number_slider_2 = Slider(1, range=0..1)
axis_z = Slider(270, range=0..360)
axis_tcp = Slider(0, range=0..360)
cluster_8 = Cluster_9(curve=curve_4, A=number_slider_2, a_1=degrees(axis_line), angle=degrees(axis_z), angle_2=degrees(axis_tcp))

# ----
# Robot TCP control
axis_tcp_2 = Slider(0, range=0..360)
number_slider_3 = Slider(0, range=0..1)
axis_z_2 = Slider(90, range=0..360)
axis_line_2 = Slider(90, range=0..360)
cluster_9 = Cluster_9(curve=curve_4, A=number_slider_3, a_1=degrees(axis_line_2), angle=degrees(axis_z_2), angle_2=degrees(axis_tcp_2))

move = Move(Geometry=cluster_8, Motion=Z)  # -> Geometry, Transform
move_2 = Move(Geometry=cluster_9, Motion=Z_2)  # -> Geometry, Transform

cluster_10 = Cluster_12(list=move.Geometry, offset=division)
cluster_11 = Cluster_14(list=move.Geometry, offset=division)
merge = Merge(Data1=flatten(move.Geometry), Data2=flatten(cluster_11))

laster = Cluster_14(list=move_2.Geometry, offset=division)
cluster_12 = Cluster_12(list=move_2.Geometry, offset=division)
merge_2 = Merge(Data1=flatten(move_2.Geometry), Data2=flatten(laster))

value_list_2 = ValueList({"gripper open": 0, "gripper close": 1, "gripper close": 1}, selected="gripper close")
gripper_cmd = Gripper_Cmd(i=value_list_2)  # -> gripper_geo_2, flatten(command_2)
create_target = CreateTarget(Plane=flatten(merge), IsCartesian=True)
list_2 = FlagFields({"Shoulder": 1, "Elbow": 2, "Wrist": 4}, selected=[])
list_3 = ValueList({"Joint", "Linear"}, selected="Linear")

value_list_3 = ValueList({"gripper open": 0, "gripper close": 1, "gripper close": 1}, selected="gripper close")
gripper_cmd_2 = Gripper_Cmd(i=value_list_3)  # -> gripper_geo_2, flatten(command_2)
create_target_2 = CreateTarget(Plane=flatten(merge_2), IsCartesian=True)
list_4 = FlagFields({"Shoulder": 1, "Elbow": 2, "Wrist": 4}, selected=[])
list_5 = ValueList({"Joint", "Linear"}, selected="Linear")

create_target_3 = CreateTarget(
    Target=create_target,
    RobConf=list_2,
    Motion=list_3,
    Tool=gripper_cmd.gripper_geo_2,
    Speed=speed,
    Command=gripper_cmd.command_2,
    IsCartesian=True)
create_target_4 = CreateTarget(Plane=cluster_10, RobConf=list_2, Motion=list_3, Tool=gripper_cmd.gripper_geo_2, Command=groupcmd, IsCartesian=True)

create_target_5 = CreateTarget(
    Target=create_target_2,
    RobConf=list_4,
    Motion=list_5,
    Tool=gripper_cmd_2.gripper_geo_2,
    Speed=speed,
    Command=gripper_cmd_2.command_2,
    IsCartesian=True)
create_target_6 = CreateTarget(Plane=cluster_12, RobConf=list_4, Motion=list_5, Tool=gripper_cmd_2.gripper_geo_2, Command=groupcmd, IsCartesian=True)

cluster_13 = Cluster_7(T=create_target_5, translation=Slider(62, range=0..100))

cluster_14 = Cluster_7(T=create_target_3, translation=Slider(62, range=0..100))

entwine = Entwine(Branch00=create_target_6, Branch01=cluster_13, FlattenInputs=True)  # -> flatten(Result)
entwine_2 = Entwine(Branch00=create_target_4, Branch01=cluster_14, FlattenInputs=True)  # -> flatten(Result)

# ----
# Program - A
cluster_15 = Cluster_2()
cluster_16 = Cluster_4()
create_program = CreateProgram(Name="DefaultProgram", RobotSystem=cluster_16, Targets=flatten(entwine), InitCommands=cluster_15, StepSize=1)  # -> Program, Code, Duration, Warnings, Errors

# ----
# Program - B
cluster_17 = Cluster_2()
cluster_18 = Cluster_3()
create_program_2 = CreateProgram(Name="DefaultProgram", RobotSystem=cluster_18, Targets=flatten(entwine_2), InitCommands=cluster_17, StepSize=1)  # -> Program, Code, Duration, Warnings, Errors

# ----
# Ginger
detarget = DeconstructTarget(Target=flatten(entwine))  # -> Plane, Motion, Speed, Command
panel_2 = Panel("C:\Users\dg-admin\Desktop\DDU_Seminar\SS25_Robotic Collaboration\data")
display_tcp = DisplayTCP_2(tcp_plane=detarget.Plane)
ft = FormatTargets(Planes=detarget.Plane, MotionTypes=detarget.Motion, Speeds=detarget.Speed, Commands=detarget.Command)  # -> Targets_Data; inputs Planes: list of Plane, MotionTypes: list, Speeds: list, Commands: list
# ---------- ft: Python ----------
#r: numpy
##-------------------------------------------------------------------##
#                            META DATA                                #
##-------------------------------------------------------------------##
__author__ = "Yuxi Liu"
__laboratory__ = "DDU, Digital Design Unit - Prof. Oliver Tessmann"
__university__ = "TUDa, Technische Universität Darmstadt"

##-------------------------------------------------------------------##
#                            COMPONENT INFO                           #
##-------------------------------------------------------------------##
"""
Package structured UR robot targets from plane & motion data.
Provided by DDU_Robot 0.1

    Args:
        P: Planes (List[Rhino.Geometry.Plane]) – TCP frames
        S: Speed objects (with .TranslationSpeed, .TranslationAccel)
        M: Motion types (e.g. "Linear", "Joint")
        C: Command groups (e.g. "Picking", "Drawing", "GripCode_Grasp")

    Returns:
        Targets_Data: JSON-like robot instruction objects (GH DataTree)
"""

# Grasshopper Component UI Settings
ghenv.Component.Name = "Format Targets"
ghenv.Component.NickName = "FT"
ghenv.Component.Message = "Format Targets"


# Set input parameter names/descriptions
ghenv.Component.Params.Input[0].Name = "Planes"
ghenv.Component.Params.Input[0].Description = "TCP coordinate planes"

ghenv.Component.Params.Input[1].Name = "MotionTypes"
ghenv.Component.Params.Input[1].Description = "Motion types (Linear, Joint)"

ghenv.Component.Params.Input[2].Name = "Speeds"
ghenv.Component.Params.Input[2].Description = "Speed + Acceleration objects"


ghenv.Component.Params.Input[3].Name = "Commands"
ghenv.Component.Params.Input[3].Description = "Gripper and task command data"

# Set output parameter names/descriptions
ghenv.Component.Params.Output[0].Name = "Targets_Data"
ghenv.Component.Params.Output[0].Description = "Structured robot targets (GH DataTree)"


##-------------------------------------------------------------------##
#                            IMPORT MODULES                           #
##-------------------------------------------------------------------##
import json
import numpy as np
import Rhino.Geometry as rg
import ghpythonlib.treehelpers as gt

##-------------------------------------------------------------------##
#                            FUNCTION DEFINITIONS                     #
##-------------------------------------------------------------------##

def convert_planes_to_tcp_poses(planes):
    def handle_180_deg_rotation(rot_matrix, epsilon):
        angle = np.pi
        xx, yy, zz = (rot_matrix[0, 0] + 1) / 2, (rot_matrix[1, 1] + 1) / 2, (rot_matrix[2, 2] + 1) / 2
        xy, xz, yz = (rot_matrix[0, 1] + rot_matrix[1, 0]) / 4, (rot_matrix[0, 2] + rot_matrix[2, 0]) / 4, (rot_matrix[1, 2] + rot_matrix[2, 1]) / 4

        if xx > yy and xx > zz:
            Rx, Ry, Rz = (0, 0.7071, 0.7071) if xx < epsilon else (np.sqrt(xx), xy / np.sqrt(xx), xz / np.sqrt(xx))
        elif yy > zz:
            Rx, Ry, Rz = (0.7071, 0, 0.7071) if yy < epsilon else (xy / np.sqrt(yy), np.sqrt(yy), yz / np.sqrt(yy))
        else:
            Rx, Ry, Rz = (0.7071, 0.7071, 0) if zz < epsilon else (xz / np.sqrt(zz), yz / np.sqrt(zz), np.sqrt(zz))

        axis = np.array([Rx, Ry, Rz], dtype=np.float64)
        return tuple(axis / np.linalg.norm(axis) * angle)

    def handle_general_rotation(rot_matrix, epsilon):
        s = np.sqrt((rot_matrix[2, 1] - rot_matrix[1, 2])**2 +
                    (rot_matrix[0, 2] - rot_matrix[2, 0])**2 +
                    (rot_matrix[1, 0] - rot_matrix[0, 1])**2)
        s = max(s, epsilon)
        angle = np.arccos((np.trace(rot_matrix) - 1) / 2)

        Rx = (rot_matrix[2, 1] - rot_matrix[1, 2]) / s
        Ry = (rot_matrix[0, 2] - rot_matrix[2, 0]) / s
        Rz = (rot_matrix[1, 0] - rot_matrix[0, 1]) / s

        axis = np.array([Rx, Ry, Rz], dtype=np.float64)
        return tuple(axis / np.linalg.norm(axis) * angle)

    tcp_poses = []
    epsilon = 0.01
    epsilon2 = 0.1

    for plane in planes:
        x_axis, y_axis, z_axis = plane.XAxis, plane.YAxis, plane.ZAxis
        rot_matrix = np.array([[x_axis.X, y_axis.X, z_axis.X],
                               [x_axis.Y, y_axis.Y, z_axis.Y],
                               [x_axis.Z, y_axis.Z, z_axis.Z]], dtype=np.float64)

        x, y, z = plane.Origin.X / 1000.0, plane.Origin.Y / 1000.0, plane.Origin.Z / 1000.0

        if np.abs(rot_matrix[0, 1] - rot_matrix[1, 0]) < epsilon and \
           np.abs(rot_matrix[0, 2] - rot_matrix[2, 0]) < epsilon and \
           np.abs(rot_matrix[1, 2] - rot_matrix[2, 1]) < epsilon:
            if np.abs(np.trace(rot_matrix) - 3) < epsilon2:
                Rx, Ry, Rz = 0.0, 0.0, 0.0
            else:
                Rx, Ry, Rz = handle_180_deg_rotation(rot_matrix, epsilon)
        else:
            Rx, Ry, Rz = handle_general_rotation(rot_matrix, epsilon)

        tcp_poses.append({
            'x': x, 'y': y, 'z': z,
            'Rx': float(Rx), 'Ry': float(Ry), 'Rz': float(Rz)
        })

    return tcp_poses


def extract_speed_and_acceleration(motion_data):
    speeds = [m.TranslationSpeed / 1000.0 for m in motion_data]
    accels = [m.TranslationAccel / 1000.0 for m in motion_data]
    return speeds, accels


def interpret_motion_and_gripper_data(motion_types_input, command_data):
    motion_types = list(motion_types_input)
    gripper_states = []
    task_classifications = []

    for cmd_group in command_data:
        task, gripper = "Unknown", "None"
        cmd_group_str = str(cmd_group)

        if 'Group' in cmd_group_str:
            for cmd in cmd_group:
                cmd_str = str(cmd)
                if 'Picking' in cmd_str: task = "Picking"
                if 'Placing' in cmd_str: task = "Placing"
                elif 'Drawing' in cmd_str: task = "Drawing"
                if 'GripCode_Release' in cmd_str: gripper = "Release"
                elif 'GripCode_Grasp' in cmd_str: gripper = "Grasp"
        else:
            if 'Picking' in cmd_group_str: task = "Picking"
            if 'Placing' in cmd_str: task = "Placing"
            elif 'Drawing' in cmd_group_str: task = "Drawing"
            if 'GripCode_Release' in cmd_group_str: gripper = "Release"
            elif 'GripCode_Grasp' in cmd_group_str: gripper = "Grasp"

        gripper_states.append(gripper)
        task_classifications.append(task)

    return motion_types, gripper_states, task_classifications


def build_robot_instruction(poses, motions, grippers, speeds, accels, tasks):
    structured = []
    for i in range(len(poses)):
        structured.append({
            'RobotTask': tasks[i],
            f'Tcp_TargetPose_{i}': poses[i],
            f'TargetPose_{i}_Speed': speeds[i],
            f'TargetPose_{i}_Acceleration': accels[i],
            'MotionType': motions[i],
            'GripperCmd': grippers[i]
        })
    return gt.list_to_tree(structured)

##-------------------------------------------------------------------##
#                            MAIN EXECUTION                           #
##-------------------------------------------------------------------##

try:
    tcp_pose_list = convert_planes_to_tcp_poses(Planes)
    speed_list, accel_list = extract_speed_and_acceleration(Speeds)
    motion_types, gripper_cmds, robot_tasks = interpret_motion_and_gripper_data(MotionTypes, Commands)
    Targets_Data = build_robot_instruction(tcp_pose_list, motion_types, gripper_cmds, speed_list, accel_list, robot_tasks)
except Exception as e:
    Targets_Data = str(e)
# ---------- end ft ----------
ej = ExportToJSON(name="pose_data_ginger", file_path=panel_2, save=save, Targets_Data=ft)  # -> message; inputs name: String, file_path: String, save: Boolean, Targets_Data: list
# ---------- ej: Python ----------
##-------------------------------------------------------------------##
#                            META DATA                                #
##-------------------------------------------------------------------##
__author__ = "Yuxi Liu"
__laboratory__ = "DDU, Digital Design Unit - Prof. Oliver Tessmann"
__university__ = "TUDa, Technische Universität Darmstadt"

##-------------------------------------------------------------------##
#                            COMPONENT INFO                           #
##-------------------------------------------------------------------##
"""
Export structured motion data to JSON file.
Provided by DDU_Robot 0.1

    Args:
        Data: Data to export (dict or list)
        file_path: Path to target folder (string)
        save: Boolean flag to trigger saving

    Returns:
        message: Status string of the export operation
"""

# Grasshopper UI Metadata (if used in GhPython)
ghenv.Component.Name = "Export to JSON"
ghenv.Component.NickName = "EJ"
ghenv.Component.Message = "Export JSON"

ghenv.Component.Category = "DDU_Robot"
ghenv.Component.SubCategory = "1 | Json"

# Input descriptions

ghenv.Component.Params.Input[0].Name = "file_path"
ghenv.Component.Params.Input[0].Description = "Target folder path"

ghenv.Component.Params.Input[1].Name = "save"
ghenv.Component.Params.Input[1].Description = "Trigger export (True)"

ghenv.Component.Params.Input[2].Name = "Targets_Data"
ghenv.Component.Params.Input[2].Description = "Targets_Data to export (dict or list)"


# Output
ghenv.Component.Params.Output[0].Name = "message"
ghenv.Component.Params.Output[0].Description = "Export status message"

##-------------------------------------------------------------------##
#                            IMPORT MODULES                           #
##-------------------------------------------------------------------##
import json
import os

##-------------------------------------------------------------------##
#                            MAIN FUNCTION                            #
##-------------------------------------------------------------------##

def data_to_json(data, folder_path,name):
    """
    Serializes the data to JSON and writes it to a file.

    Args:
        data (dict or list): The data to export.
        folder_path (str): The folder path where the JSON file will be saved.

    Returns:
        str: File path or error message.
    """
    try:
        os.makedirs(folder_path, exist_ok=True)
        file_name = "{}.json".format(name)
        file_path = os.path.join(folder_path, file_name)
        json_data = json.dumps(data, indent=4)

        with open(file_path, 'w') as json_file:
            json_file.write(json_data)

        return f"✅ Data successfully written to: {file_path}"
    except Exception as e:
        return f"❌ Error while saving JSON data: {e}"

##-------------------------------------------------------------------##
#                            EXECUTION                                #
##-------------------------------------------------------------------##
if save:
    message = data_to_json(Targets_Data, file_path,name)
else:
    message = "Waiting for export trigger (save = True)"
# ---------- end ej ----------

# ----
# Fred
detarget_2 = DeconstructTarget(Target=flatten(entwine_2))  # -> Plane, Motion, Speed, Command
X = UnitX(Factor="-1700")
panel_3 = Panel("C:\Users\dg-admin\Desktop\DDU_Seminar\SS25_Robotic Collaboration\data")
move_3 = Move(Geometry=detarget_2.Plane, Motion=X)  # -> Geometry, Transform
display_tcp_2 = DisplayTCP_2(tcp_plane=move_3.Geometry)
ft_2 = FormatTargets(Planes=move_3.Geometry, MotionTypes=detarget_2.Motion, Speeds=detarget_2.Speed, Commands=detarget_2.Command)  # -> Targets_Data; inputs Planes: list of Plane, MotionTypes: list, Speeds: list, Commands: list; same code as ft
ej_2 = ExportToJSON(name="pose_data_fred", file_path=panel_3, save=save, Targets_Data=ft_2)  # -> message; inputs name: String, file_path: String, save: Boolean, Targets_Data: list; same code as ej

entwine_3 = Entwine(Branch00=create_program_2.Program, Branch01=create_program.Program, FlattenInputs=True)  # -> flatten(Result)

# ----
# Simulation
control_knob = ControlKnob(Decimals=4, Limit=True, Maximum=1, Minimum=0, Range=1, Value=0.1117)
program_simulation = ProgramSimulation(Program=entwine_3, Time=control_knob, Normalized=True)  # -> flatten(SystemMeshes), JointRotations, Plane, Index, Time, Program, Errors
simple_trail = SimpleTrail(Program=program_simulation.Program, Length=500, MechanicalGroup=0)

# ----
# Robot Connection
remote_connection = RemoteConnection(Program=create_program_2.Program, IP="192.168.1.102", Upload=upload, Play=play, Pause=pause)

mesh = Mesh(graft(program_simulation.SystemMeshes))
custom_preview_2 = CustomPreview(Geometry=mesh, Material=ColourSwatch(SwatchColor=RGBA(38, 67, 162, 83)))

# ==== cluster RealTimeFeedback
robot_name = ClusterInput()
panel = Panel(robot_name)
set_union = SetUnion(SetA="DDU-UR10-Fred", SetB=panel)
robot_name_2 = Data(robot_name)
list_length = ListLength(List=set_union)
equality = Equality(FirstNumber=list_length, SecondNumber=1)  # -> Equality, Inequality
ipy2 = IronPython2Script(Robot_Name=robot_name_2)  # -> Robot_IP; inputs Robot_Name: String
# ---------- ipy2: IronPython ----------
if Robot_Name == "DDU-UR10-Ginger":
    Robot_IP = "192.168.1.101"

if Robot_Name == "DDU-UR10-Fred":
    Robot_IP = "192.168.1.102"
# ---------- end ipy2 ----------

# ---- group: ginger
loadrobot = LoadRobotSystem(Name=robot_name_2, Base=PlaneXY(0, 0, 0))

# ---- group: Fred
loadrobot_2 = LoadRobotSystem(Name=robot_name_2, Base=PlaneXY(1700, 0, 0))

# ----
getdata = ClusterInput()

# ---- group: Get RobotData Once
ipy2_2 = IronPython2Script(getData=getdata, ip=ipy2)  # -> out, DataNames, DataDescription, RobotData
# ---------- ipy2_2: IronPython ----------
import clr
import sys
import os

# Find the DLL path
package_dir = r"C:\Users\dg-admin\AppData\Roaming\McNeel\Rhinoceros\packages\8.0\Robots\1.8.0"
dll_dir = os.path.join(package_dir, "lib", "net472")  # Adjust if different
sys.path.append(dll_dir)

# Add reference to DLL
clr.AddReference("Robots")

import Robots
from Robots import *
from Grasshopper import DataTree
from Grasshopper.Kernel.Data import *
from Grasshopper.Kernel.Data import GH_Path

DataAsTree = DataTree[object]()
FeedbackDesc = []
FeedbackNames = []

if getData == True:
    DataAsTree = DataTree[object]()
    DataAsTree.ClearData()

    datapack = []


    RobotConnection = URRealTime(ip)
    FeedbackData = RobotConnection.FeedbackData
    RobotConnection.UpdateFeedback()

    for i in range(len(FeedbackData)):
        if i < len(FeedbackNames):
            FeedbackNames[i] = FeedbackData[i].Meaning
            FeedbackDesc[i] = FeedbackData[i].Notes
        else:
            FeedbackNames.append(FeedbackData[i].Meaning)
            FeedbackDesc.append(FeedbackData[i].Notes)

        datapack = []
        for k in range(len(FeedbackData[i].Value)):
            datapack.append(FeedbackData[i].Value[k])
        
        path = GH_Path(i)
        DataAsTree.AddRange(datapack,path)
        #print(path)
RobotData = DataAsTree
DataDescription = FeedbackDesc
DataNames = FeedbackNames
# ---------- end ipy2_2 ----------
robot_feedback_data = Data(ipy2_2.RobotData)

# ----
stream_filter = StreamFilter(Gate=equality.Equality, Stream0=loadrobot, Stream1=loadrobot_2)

# ---- group: Actual Joint Position
# Comment: Get the 7th path, which holds the current Joint angles.
# See here for what the other branches hold:
# https://www.universal-robots.com/articles/ur/real-time-data-exchange-rtde-guide/
# Comment: Join all Numbers into one String. This string can then be used to create a ROBOTS-Joint-Target.
panel_2 = Panel("7")
robot_feedback_data_2 = Data(robot_feedback_data)
construct_path = ConstructPath(Indices=panel_2)
tree_branch = TreeBranch(Tree=robot_feedback_data_2, Path=construct_path, MaintainPaths=True)
jointangles_num = Number(tree_branch)
text_join = TextJoin(Text=jointangles_num, Join=",")
jointangle_txt = Text(text_join)

# ----
list = ValueList({"Gripper_Open": 0, "Gripper_Close": 1}, selected="Gripper_Close")
cluster = Cluster(i=list)

# ---- group: Create Robot Meshes with Joint Positions
display_geo = BooleanToggle(True)
create_target = CreateTarget(Joints=jointangle_txt, Tool=cluster, IsCartesian=False)
kinematics = Kinematics(RobotSystem=stream_filter, Target=create_target, DisplayGeometry=display_geo)  # -> Meshes, Joints, Planes, Errors
robotplanes_pln = Plane(kinematics.Planes)
lastdex = LastIndex(List=robotplanes_pln)
item = ListItem(List=robotplanes_pln, Index=lastdex, Wrap=True)

# ---- group: visualize robot
py3 = Python3Script(Run=Toggle(True), Meshlst=kinematics.Meshes)  # -> Valid_Meshlst; inputs Meshlst: list of Mesh
# ---------- py3: Python ----------
import Rhino.Geometry as rg

def repair_meshes(stlMeshes):
    """
    Repairs a list of meshes by applying the following fixes:
    - Combines identical vertices and normals
    - Removes degenerate faces
    - Unifies normals
    - Rebuilds normals
    - Compacts the mesh
    
    Parameters:
    stlMeshes (list): List of Rhino meshes to repair.
    
    Returns:
    list: List of repaired meshes.
    """
    repaired_meshes = []

    for mesh in stlMeshes:
        if mesh is None:
            continue  # Skip any invalid meshes

        # Combine identical vertices and normals to remove redundancy
        mesh.Vertices.CombineIdentical(True, True)

        # Cull degenerate faces (faces with no area)
        mesh.Faces.CullDegenerateFaces()

        # Unify normals (correct any flipped normals)
        mesh.UnifyNormals()

        # Rebuild normals to ensure proper orientation
        mesh.RebuildNormals()

        # Compact the mesh to remove unused vertices, faces, and other elements
        mesh.Compact()

        # Add the repaired mesh to the list of repaired meshes
        repaired_meshes.append(mesh)

    return repaired_meshes

# Example usage with a list of meshes
# stlMeshes is a list of mesh objects (replace this with your actual meshes)
stlMeshes = Meshlst  # Example list, replace with your meshes

if Run:
    # Repair the meshes
    repaired_meshes = repair_meshes(stlMeshes)

    # Output the repaired meshes to Grasshopper (assuming 'a' is the output parameter)
    Valid_Meshlst = repaired_meshes
else:
    Valid_Meshlst = None
# ---------- end py3 ----------
colour = RenderColour(
    BakeMesh=False,
    RobotMesh=py3,
    RobotBase=ColourSwatch(SwatchColor=RGB(255, 0, 0)),
    RobotBody=ColourSwatch(SwatchColor=RGB(18, 141, 166)),
    EndEffector=ColourSwatch(SwatchColor=RGB(117, 117, 117)),
    ExternalBase=RGB(211, 211, 211),
    ExternalBody=RGB(255, 165, 0))  # -> Mesh, Colour, Labels

# ----
real_tcp_plane = Plane(item)
real_tcp_plane_2 = ClusterOutput(real_tcp_plane)
display_tcp = DisplayTCP(tcp_plane=real_tcp_plane)

# ==== cluster Cluster_2
panel = Panel("""set_tool_voltage(24)
  set_standard_analog_input_domain(0, 1)
  set_standard_analog_input_domain(1, 1)
  set_tool_analog_input_domain(0, 1)
  set_tool_analog_input_domain(1, 1)
  set_analog_outputdomain(0, 0)
  set_analog_outputdomain(1, 0)
  set_input_actions_to_default()
  set_gravity([0.0, 0.0, 9.82])
  set_safety_mode_transition_hardness(0)
  step_count_9c131681_a57c_45b6_bfe3_51c21d9981b6 = 0.0
  thread Step_Counter_Thread_fc574cfd_fa5c_4090_94ec_fc73f9634c36():
    while (True):
      step_count_9c131681_a57c_45b6_bfe3_51c21d9981b6 = step_count_9c131681_a57c_45b6_bfe3_51c21d9981b6 + 1.0
      sync()
    end
  end
  run Step_Counter_Thread_fc574cfd_fa5c_4090_94ec_fc73f9634c36()
  set_tcp(p[0.0,0.0,0.0,0.0,0.0,0.0])
  set_payload(1.0)
  # begin: URCap Installation Node
  #   Source: EGH-SCHUNK, 1.0.2, SCHUNK GmbH & Co. KG
  #   Type: SCHUNK EGH Gripper
    EGH = rpc_factory("xmlrpc", "http://127.0.0.1:40408/RPC2")
  error_updated = False
  error_internal = 0
  c_modbus_ip_address = "192.168.1.253"
  c_modbus_slave_nr = 255
  c_modbus_freq = 125
  c_modbus_thread_sleep = 1/c_modbus_freq
  

	c_addr_in_start_address = 1
	c_addr_in_data_01 = c_addr_in_start_address
	c_addr_in_data_02 = c_addr_in_start_address + 1
	c_addr_in_data_03 = c_addr_in_start_address + 2
	c_addr_in_data_04 = c_addr_in_start_address + 3
	c_numInputRegs = 4
	
	c_addr_in_idx = [c_addr_in_data_01, 
	                 c_addr_in_data_02, 
	                 c_addr_in_data_03, 
	                 c_addr_in_data_04]
	
	c_addr_out_start_address = 2049
	c_addr_out_data_01 = c_addr_out_start_address
	c_addr_out_data_02 = c_addr_out_start_address + 1
	c_addr_out_data_03 = c_addr_out_start_address + 2
	c_addr_out_data_04 = c_addr_out_start_address + 3
	c_numOutputRegs = 4
	
	c_addr_out_idx = [c_addr_out_data_01,
	                  c_addr_out_data_02,
	                  c_addr_out_data_03,
	                  c_addr_out_data_04]

	
	def getModbusInputByIndex(idx):    
	    if idx == c_addr_in_data_01:
	        return "MI_Data_01"
	    elif idx == c_addr_in_data_02:
	        return "MI_Data_02"
	    elif idx == c_addr_in_data_03:
	        return "MI_Data_03"
	    elif idx == c_addr_in_data_04:
	        return "MI_Data_04" 
	    else: 
	        return ""
	    end  
	end 
	
	sync()   
	def getModbusOutputByIndex(idx):
	    if idx == c_addr_out_data_01:
	        return "MO_Data_01"
	    elif idx == c_addr_out_data_02:
	        return "MO_Data_02"
	    elif idx == c_addr_out_data_03:
	        return "MO_Data_03"
	    elif idx == c_addr_out_data_04:
	        return "MO_Data_04" 
	    else: 
	        return ""
	    end
	end
	  
	idx = 0 
	while(idx < c_numInputRegs):
	    idxName = getModbusInputByIndex(c_addr_in_idx[idx])
	    modbus_add_signal(c_modbus_ip_address, c_modbus_slave_nr, c_addr_in_idx[idx], 2, idxName, False)
	    modbus_set_signal_update_frequency(idxName, c_modbus_freq)
	    idx = idx + 1
	end 
	
	idx = 0 
	while(idx < c_numOutputRegs):
	    idxName = getModbusOutputByIndex(c_addr_out_idx[idx])
	    modbus_add_signal(c_modbus_ip_address, c_modbus_slave_nr, c_addr_out_idx[idx], 3, idxName, False)
	    modbus_set_signal_update_frequency(idxName, c_modbus_freq)
	    #modbus_set_runstate_dependent_choice(idxName,0) # preserve values
	    #modbus_set_runstate_dependent_choice(idxName,1) # set all values to low when program not running
	    idx = idx + 1
	end 
	
	def getInputData(addr):
	    name = getModbusInputByIndex(addr)
	    if name == "":
	        popup("getInputData(): Wrong input address index value detected", error=True, blocking=True)
	    end 
	    return modbus_get_signal_status(name, False)
	end
	
	inData01 = 0
	inData02 = 0
	inData03 = 0
	inData04 = 0
	
	inProcessCmd = False
	inBlocked = False
	inEndStop = False
	inSuccess = False
	inReferenced = False
	inStatus = 0
	
	def decodeInData01():
	    bitList = integer_to_binary_list(inData01)
	    
	    inStatus = binary_list_to_integer([bitList[8],bitList[9],bitList[10]])
	    inReferenced = bitList[11]
	    inSuccess = bitList[12]
	    inEndStop = bitList[13]
	    inBlocked = bitList[14]
	    inProcessCmd = bitList[15]
	end 
	
	endStop1 = False 
	endStop2 = False  
	    
	def decodeInData02():
	    bitList = integer_to_binary_list(inData02) 
	    endStop1 = bitList[8]
	    endStop2 = bitList[9]
	end 
	
	#global actualPosition = 0
	#def decodeInData0304():
	#    bitList03 = integer_to_binary_list(inData03)
	#    bitList04 = integer_to_binary_list(inData04)
	#    
	#    while idx < 16:
	#        bitList03[idx + 16] = bitList04[idx]
	#        idx = idx + 1 
	#    end 
	#    
	#    actualPosition = binary_list_to_integer(bitList03)
	#end 
	
	thread modbusThread():
	    while True:
	    
	        inData01 = getInputData(c_addr_in_data_01)
	        inData02 = getInputData(c_addr_in_data_02)	        
	        inData03 = getInputData(c_addr_in_data_03)
	        inData04 = getInputData(c_addr_in_data_04)
	        
	        decodeInData01()
	        decodeInData02()
	        
	        sleep(c_modbus_thread_sleep)
	    end 
	    return False
	end     
	
	modbus = run modbusThread()

  
  def EGH_error():
          if EGH.getActStatus() != 3:
              if error_updated == False:
                  error_internal = EGH.getDetailDeviceStatus(1)
                  error_updated = True
              end
              return error_internal
          else:
              error_updated = False
              error_internal = 0
              return 0
          end
  end
  def EGH_reference_ok():
          return inReferenced
  end
  def _reference_ok():
          sync()
          return EGH.get_Referenced()
  end
  def EGH_is_success():
          return inSuccess
  end
  def _is_success():
          sync()
          return EGH.isSuccess()
  end
  def EGH_is_blocked():
          return inBlocked
  end
  def _is_blocked():
          sync()
          return EGH.isBlocked()
  end
  def EGH_is_endstop():
          return inEndStop
  end
  def _is_endstop():
          sync()
          return EGH.isEndStop()
  end
  def EGH_is_closed():
          sync()
          return EGH.isClosed()
  end
  def EGH_is_open():
          sync()
          return EGH.isOpen()
  end
  def EGH_in_pos():
          sync()
          return EGH.isInPosition()
  end
  def EGH_actual_pos():
          sync()
          return EGH.get_CurrentPosition()
  end
  def EGH_status():
          return inStatus
  end
  def _status():
          sync()
          return EGH.getActStatus()
  end
  def EGH_error_check(name):
      local err =  _status()
      if (err != 3):
          local err =  EGH_error()
          err_msg = EGH.getErrorMsg(err)
          textmsg(name, err_msg)
          popup(err_msg, title=name, error=True, blocking=True)
      end
      EGH_conn_check(name)
  end
  def EGH_conn_check(name):
      if (not EGH.is_connected()):
          err_msg = "Gripper disconnected"
          textmsg(name, err_msg)
          popup(err_msg, title=name, error=True, blocking=True)
          halt
      end
  end
  def EGH_goto_pos(value):
          sync()
      EGH.cmdPositioning(value)
  end
  def EGH_gripped_workpiece(wp):
      return EGH.isGrippedWp(wp)
  end
  
  EGH.resetPrgBreak()
  Gripper_LB_Enabled = True
  if (Gripper_LB_Enabled):
    set_digital_out(1, False)
    set_digital_out(2, True)
  end""")

panel_2 = Panel("""set_tool_voltage(24)
  set_standard_analog_input_domain(0, 1)
  set_standard_analog_input_domain(1, 1)
  set_tool_analog_input_domain(0, 1)
  set_tool_analog_input_domain(1, 1)
  set_analog_outputdomain(0, 0)
  set_analog_outputdomain(1, 0)
  set_input_actions_to_default()
  set_gravity([0.0, 0.0, 9.82])
  set_safety_mode_transition_hardness(0)
  step_count_9c131681_a57c_45b6_bfe3_51c21d9981b6 = 0.0
  thread Step_Counter_Thread_fc574cfd_fa5c_4090_94ec_fc73f9634c36():
    while (True):
      step_count_9c131681_a57c_45b6_bfe3_51c21d9981b6 = step_count_9c131681_a57c_45b6_bfe3_51c21d9981b6 + 1.0
      sync()
    end
  end
  run Step_Counter_Thread_fc574cfd_fa5c_4090_94ec_fc73f9634c36()
  set_tcp(p[0.0,0.0,0.0,0.0,0.0,0.0])
  set_payload(1.0)
  # begin: URCap Installation Node
  #   Source: EGH-SCHUNK, 1.0.2, SCHUNK GmbH & Co. KG
  #   Type: SCHUNK EGH Gripper
    EGH = rpc_factory("xmlrpc", "http://127.0.0.1:40408/RPC2")
  error_updated = False
  error_internal = 0
  c_modbus_ip_address = "192.168.1.253"
  c_modbus_slave_nr = 255
  c_modbus_freq = 125
  c_modbus_thread_sleep = 1/c_modbus_freq
  

	c_addr_in_start_address = 1
	c_addr_in_data_01 = c_addr_in_start_address
	c_addr_in_data_02 = c_addr_in_start_address + 1
	c_addr_in_data_03 = c_addr_in_start_address + 2
	c_addr_in_data_04 = c_addr_in_start_address + 3
	c_numInputRegs = 4
	
	c_addr_in_idx = [c_addr_in_data_01, 
	                 c_addr_in_data_02, 
	                 c_addr_in_data_03, 
	                 c_addr_in_data_04]
	
	c_addr_out_start_address = 2049
	c_addr_out_data_01 = c_addr_out_start_address
	c_addr_out_data_02 = c_addr_out_start_address + 1
	c_addr_out_data_03 = c_addr_out_start_address + 2
	c_addr_out_data_04 = c_addr_out_start_address + 3
	c_numOutputRegs = 4
	
	c_addr_out_idx = [c_addr_out_data_01,
	                  c_addr_out_data_02,
	                  c_addr_out_data_03,
	                  c_addr_out_data_04]

	
	def getModbusInputByIndex(idx):    
	    if idx == c_addr_in_data_01:
	        return "MI_Data_01"
	    elif idx == c_addr_in_data_02:
	        return "MI_Data_02"
	    elif idx == c_addr_in_data_03:
	        return "MI_Data_03"
	    elif idx == c_addr_in_data_04:
	        return "MI_Data_04" 
	    else: 
	        return ""
	    end  
	end 
	
	sync()   
	def getModbusOutputByIndex(idx):
	    if idx == c_addr_out_data_01:
	        return "MO_Data_01"
	    elif idx == c_addr_out_data_02:
	        return "MO_Data_02"
	    elif idx == c_addr_out_data_03:
	        return "MO_Data_03"
	    elif idx == c_addr_out_data_04:
	        return "MO_Data_04" 
	    else: 
	        return ""
	    end
	end
	  
	idx = 0 
	while(idx < c_numInputRegs):
	    idxName = getModbusInputByIndex(c_addr_in_idx[idx])
	    modbus_add_signal(c_modbus_ip_address, c_modbus_slave_nr, c_addr_in_idx[idx], 2, idxName, False)
	    modbus_set_signal_update_frequency(idxName, c_modbus_freq)
	    idx = idx + 1
	end 
	
	idx = 0 
	while(idx < c_numOutputRegs):
	    idxName = getModbusOutputByIndex(c_addr_out_idx[idx])
	    modbus_add_signal(c_modbus_ip_address, c_modbus_slave_nr, c_addr_out_idx[idx], 3, idxName, False)
	    modbus_set_signal_update_frequency(idxName, c_modbus_freq)
	    #modbus_set_runstate_dependent_choice(idxName,0) # preserve values
	    #modbus_set_runstate_dependent_choice(idxName,1) # set all values to low when program not running
	    idx = idx + 1
	end 
	
	def getInputData(addr):
	    name = getModbusInputByIndex(addr)
	    if name == "":
	        popup("getInputData(): Wrong input address index value detected", error=True, blocking=True)
	    end 
	    return modbus_get_signal_status(name, False)
	end
	
	inData01 = 0
	inData02 = 0
	inData03 = 0
	inData04 = 0
	
	inProcessCmd = False
	inBlocked = False
	inEndStop = False
	inSuccess = False
	inReferenced = False
	inStatus = 0
	
	def decodeInData01():
	    bitList = integer_to_binary_list(inData01)
	    
	    inStatus = binary_list_to_integer([bitList[8],bitList[9],bitList[10]])
	    inReferenced = bitList[11]
	    inSuccess = bitList[12]
	    inEndStop = bitList[13]
	    inBlocked = bitList[14]
	    inProcessCmd = bitList[15]
	end 
	
	endStop1 = False 
	endStop2 = False  
	    
	def decodeInData02():
	    bitList = integer_to_binary_list(inData02) 
	    endStop1 = bitList[8]
	    endStop2 = bitList[9]
	end 
	
	#global actualPosition = 0
	#def decodeInData0304():
	#    bitList03 = integer_to_binary_list(inData03)
	#    bitList04 = integer_to_binary_list(inData04)
	#    
	#    while idx < 16:
	#        bitList03[idx + 16] = bitList04[idx]
	#        idx = idx + 1 
	#    end 
	#    
	#    actualPosition = binary_list_to_integer(bitList03)
	#end 
	
	thread modbusThread():
	    while True:
	    
	        inData01 = getInputData(c_addr_in_data_01)
	        inData02 = getInputData(c_addr_in_data_02)	        
	        inData03 = getInputData(c_addr_in_data_03)
	        inData04 = getInputData(c_addr_in_data_04)
	        
	        decodeInData01()
	        decodeInData02()
	        
	        sleep(c_modbus_thread_sleep)
	    end 
	    return False
	end     
	
	modbus = run modbusThread()

  
  def EGH_error():
          if EGH.getActStatus() != 3:
              if error_updated == False:
                  error_internal = EGH.getDetailDeviceStatus(1)
                  error_updated = True
              end
              return error_internal
          else:
              error_updated = False
              error_internal = 0
              return 0
          end
  end
  def EGH_reference_ok():
          return inReferenced
  end
  def _reference_ok():
          sync()
          return EGH.get_Referenced()
  end
  def EGH_is_success():
          return inSuccess
  end
  def _is_success():
          sync()
          return EGH.isSuccess()
  end
  def EGH_is_blocked():
          return inBlocked
  end
  def _is_blocked():
          sync()
          return EGH.isBlocked()
  end
  def EGH_is_endstop():
          return inEndStop
  end
  def _is_endstop():
          sync()
          return EGH.isEndStop()
  end
  def EGH_is_closed():
          sync()
          return EGH.isClosed()
  end
  def EGH_is_open():
          sync()
          return EGH.isOpen()
  end
  def EGH_in_pos():
          sync()
          return EGH.isInPosition()
  end
  def EGH_actual_pos():
          sync()
          return EGH.get_CurrentPosition()
  end
  def EGH_status():
          return inStatus
  end
  def _status():
          sync()
          return EGH.getActStatus()
  end
  def EGH_error_check(name):
      local err =  _status()
      if (err != 3):
          local err =  EGH_error()
          err_msg = EGH.getErrorMsg(err)
          textmsg(name, err_msg)
          popup(err_msg, title=name, error=True, blocking=True)
      end
      EGH_conn_check(name)
  end
  def EGH_conn_check(name):
      if (not EGH.is_connected()):
          err_msg = "Gripper disconnected"
          textmsg(name, err_msg)
          popup(err_msg, title=name, error=True, blocking=True)
          halt
      end
  end
  def EGH_goto_pos(value):
          sync()
      EGH.cmdPositioning(value)
  end
  def EGH_gripped_workpiece(wp):
      return EGH.isGrippedWp(wp)
  end
  
  EGH.resetPrgBreak()
  Gripper_LB_Enabled = True
  if (Gripper_LB_Enabled):
    set_digital_out(1, False)
    set_digital_out(2, True)
  end""")
customcmd = CustomCommand(Name="SchunkGrip_CodeLibrary", Manufacturer="All", Code=panel_2)

C = ClusterOutput(customcmd)

# ==== cluster FredOrGinger
ginger = Panel("192.168.1.101")
fred = Panel("192.168.1.102")
G = ClusterInput()
filter = StreamFilter(Gate=G, Stream0=ginger, Stream1=fred)
s_1 = ClusterOutput(filter)

# ==== cluster Gripper_Cmd
geometry = Geometry([<mesh referenced from the Rhino model> x7])
unit_z = UnitZ(Factor="187.578")
point = Point(unit_z)
xy_plane = XYPlane(Origin=point)

# ----
# DDU_Schunk Gripper_Grasp code
# EGH_error_check("EGH Grip")
#         if(not EGH.get_Referenced()):
#             popup("Gripper not referenced", title="EGH Grip", error=True, blocking=True)
#         else:
#             EGH.cmdPositioning(20)
#             sync()
#             while(EGH.isCmdActive()):
#                 EGH_error_check("EGH Grip")
#                 sync()
#             end
#         end
panel = Panel("""EGH_error_check("EGH Grip")
            if(not EGH.get_Referenced()):
                popup("Gripper not referenced", title="EGH Grip", error=True, blocking=True)
            else:
                EGH.set_DesiredPosition(1.0)
                sync()
                EGH.cmdGrip(0,0,0)
                while(EGH.isCmdActive()):
                    EGH_error_check("EGH Grip")
                    sync()
                end
            end""")
customcmd = CustomCommand(Name="GripCode_Grasp", Manufacturer="UR", Code=panel)

# ----
# DDU_Schunk Gripper_Release code
panel_2 = Panel("""EGH_error_check("EGH Grip")
        if(not EGH.get_Referenced()):
            popup("Gripper not referenced", title="EGH Grip", error=True, blocking=True)
        else:
            EGH.cmdRelease(0)
            while(EGH.isCmdActive()):
                EGH_error_check("EGH Grip")
                sync()
            end
        end""")
customcmd_2 = CustomCommand(Name="GripCode_Release", Manufacturer="UR", Code=panel_2)

i = ClusterInput()
cmd_gripper_close = CommandParameter(customcmd)
cmd_gripper_open = CommandParameter(customcmd_2)
merge = Merge(Data1=cmd_gripper_open, Data2=cmd_gripper_close)
item = ListItem(List=merge, Index=i, Wrap=True)
command = CommandParameter(item)
command_2 = ClusterOutput(command)

geometry_2 = Geometry([<mesh referenced from the Rhino model> x7])
mesh = Mesh(geometry_2)

unit_z_2 = UnitZ(Factor="187.578")
point_2 = Point(unit_z_2)
xy_plane_2 = XYPlane(Origin=point_2)
mesh_join = MeshJoin(Meshes=mesh)

create_tool = CreateTool(Name="GripperOpen", TCP=xy_plane_2, Weight="0.1", Mesh=mesh_join)  # -> Tool, TCP

geometry_3 = Geometry(create_tool.TCP)

mesh_2 = Mesh(geometry)

mesh_join_2 = MeshJoin(Meshes=mesh_2)

create_tool_2 = CreateTool(Name="GripperClose", TCP=xy_plane, Weight="0.1", Mesh=mesh_join_2)  # -> Tool, TCP

merge_2 = Merge(Data1=create_tool.Tool, Data2=create_tool_2.Tool)
list_item = ListItem(List=merge_2, Index=i, Wrap=True)  # -> flatten(Item)
gripper_geo = Data(list_item)
gripper_geo_2 = ClusterOutput(gripper_geo)

# ==== cluster FredOrGinger_2
ginger = Panel("192.168.1.101")
fred = Panel("192.168.1.102")
G = ClusterInput()
filter = StreamFilter(Gate=G, Stream0=ginger, Stream1=fred)
s_0 = ClusterOutput(filter)

# ==== cluster Cluster_3

list = RobotsLibrary({"DDU-IRB120", "DDU-UR10-Fred", "DDU-UR10-Ginger"}, selected="DDU-UR10-Fred", Type=0)
load_robot_system = LoadRobotSystem(Name=list, Base=PlaneXY(1700, 0, 0))

robot_system = ClusterOutput(load_robot_system)

# ==== cluster Cluster_4
point = Point(Point(0, 0, 0))
plane = Plane(point)

list = RobotsLibrary({"DDU-IRB120", "DDU-UR10-Fred", "DDU-UR10-Ginger"}, selected="DDU-UR10-Fred", Type=0)
load_robot_system = LoadRobotSystem(Name=list, Base=plane)

robot_system = ClusterOutput(load_robot_system)

# ==== cluster Cluster_5
gate = ClusterInput()
stream_filter = StreamFilter(Gate=gate, Stream0="150", Stream1="-150")
curve = ClusterInput()
unit_y = UnitY(Factor=stream_filter)
curve_middle = CurveMiddle(Curve=curve)
factor = ClusterInput()
move = Move(Geometry=curve_middle, Motion=unit_y)  # -> Geometry, Transform
unit_z = UnitZ(Factor=factor)
move_2 = Move(Geometry=move.Geometry, Motion=unit_z)  # -> Geometry, Transform
length = ClusterInput()
unit_x = UnitX(Factor=1)
negative = Negative(Value=length)
point = Point(move_2.Geometry)
point_2 = ClusterOutput(point)
line_sdl = LineSDL(Start=point, Direction=unit_x, Length=[negative, length])
join_curves = JoinCurves(Curves=line_sdl, Preserve=False)
curves = ClusterOutput(join_curves)

# ==== cluster Cluster_6
_0 = ClusterInput()
gate = ClusterInput()

negative = Negative(Value=_0)
stream_filter = StreamFilter(Gate=gate, Stream0=_0, Stream1=negative)

geometry = ClusterInput()
center = ClusterInput()
axis = ClusterInput()
rotate_3d = Rotate3D(Geometry=geometry, Angle=degrees(stream_filter), Center=center, Axis=axis)  # -> Geometry, Transform
geometry_2 = ClusterOutput(rotate_3d.Geometry)

# ==== cluster Cluster_7
translation = ClusterInput()
pi = Pi(Factor="0.1")
create_speed = CreateSpeed(
    Translation=translation,
    Rotation=pi,
    ExternalTranslation=5000,
    ExternalRotation=18.84955592,
    AccelTranslation=2500,
    AccelAxis=12.56637061)
T = ClusterInput()
create_target = CreateTarget(Target=T, Speed=create_speed, IsCartesian=True)
target = ClusterOutput(create_target)

# ==== cluster Cluster_8
surface = ClusterInput()
surface_2 = Surface(surface)
area = Area(Geometry=surface_2)  # -> Area, Centroid
pick_plane_up = Plane(surface_2)
point_b = ClusterInput()
move_to_point = MoveToPoint(Geometry=pick_plane_up, PointA=area.Centroid, PointB=point_b)  # -> Moved, Vector, Transform
moved = ClusterOutput(move_to_point.Moved)

# ==== cluster Cluster_9
curve = ClusterInput()
curve_2 = Curve(curve)
A = ClusterInput()

length = Length(Curve=curve_2)
multiplication = Multiplication(A=A, B=length)

evaluate_curve = EvaluateCurve(Curve=curve_2, Parameter=multiplication)  # -> Point, Tangent, Angle
a_1 = ClusterInput()
angle = ClusterInput()
align_plane = AlignPlane(Plane=evaluate_curve.Point, Direction=evaluate_curve.Tangent)  # -> Plane, Angle
rotate_axis = RotateAxis(Geometry=align_plane.Plane, Angle=degrees(a_1), Axis=curve_2)  # -> Geometry, Transform
Z = UnitZ(Factor=1)
line = LineSDL(Start=evaluate_curve.Point, Direction=Z, Length="10")
rotate_axis_2 = RotateAxis(Geometry=rotate_axis.Geometry, Angle=degrees(angle), Axis=line)  # -> Geometry, Transform
angle_2 = ClusterInput()
rotate = Rotate(Geometry=rotate_axis_2.Geometry, Angle=degrees(angle_2), Plane=rotate_axis_2.Geometry)  # -> Geometry, Transform
geometry = ClusterOutput(rotate.Geometry)

# ==== cluster Cluster_11
B = ClusterInput()
curve = ClusterInput()
curve_2 = Curve(curve)

end_points = EndPoints(Curve=curve_2)  # -> Start, End
length = Length(Curve=curve_2)
negative = Negative(Value=B)
curve_middle = CurveMiddle(Curve=curve_2)
vector_2pt = Vector2Pt(PointA=end_points.Start, PointB=end_points.End, Unitize=False)  # -> Vector, Length
multiplication = Multiplication(A=length, B=[B, negative])
amplitude = Amplitude(Vector=vector_2pt.Vector, Amplitude=multiplication)
move = Move(Geometry=curve_middle, Motion=amplitude)  # -> Geometry, Transform

polyline = PolyLine(Vertices=move.Geometry, Closed=False)
value = ClusterInput()
cluster = Cluster_10(base=polyline, value=value)
move_to_point = MoveToPoint(Geometry=curve_2, PointA=curve_middle, PointB=graft(cluster))  # -> simplify(Moved), Vector, Transform
moved = ClusterOutput(move_to_point.Moved)

# ==== cluster Cluster_12
list = ClusterInput()
list_item = ListItem(List=flatten(list), Index=0, Wrap=True)
unit_z = UnitZ(Factor=Slider(100, range=0..100))
move = Move(Geometry=list_item, Motion=unit_z)  # -> Geometry, Transform
offset = ClusterInput()
plane_offset = PlaneOffset(BasePlane=move.Geometry, Offset=offset)
merge = Merge(Data1=plane_offset, Data2=move.Geometry)
result = ClusterOutput(merge)

# ==== cluster DisplayTCP_2
tcp_plane = ClusterInput()
tcp_plane_2 = Plane(graft(tcp_plane))
size = Number("30")
deconstruct_plane = DeconstructPlane(Plane=tcp_plane_2)  # -> Origin, XAxis, YAxis, ZAxis
division = Division(A=size, B="10")
colors = Panel("yellow")
merge = Merge(Data1=deconstruct_plane.XAxis, Data2=deconstruct_plane.YAxis, Data3=deconstruct_plane.ZAxis)
colors_2 = Panel("""red
green
blue""")
amplitude = Amplitude(Vector=merge, Amplitude=size)
symbol_simple = SymbolSimple(Style="5", Size=division, Rotation=0, Colour=colors)
symbol_display = SymbolDisplay(Location=tcp_plane_2, Display=symbol_simple)
vector_display_ex = VectorDisplayEx(Point=deconstruct_plane.Origin, Vector=amplitude, Colour=colors_2, Width=2)

# ==== cluster Cluster_13
F = ClusterInput()
F_2 = ClusterInput()
G = ClusterInput()
Y = UnitY(Factor=F_2)
move = Move(Geometry=G, Motion=Y)  # -> Geometry, Transform
Z = UnitZ(Factor=F)
move_2 = Move(Geometry=move.Geometry, Motion=Z)  # -> Geometry, Transform
G_2 = ClusterOutput(move_2.Geometry)

# ==== cluster Cluster_14
list = ClusterInput()
list_length = ListLength(List=flatten(list))  # -> expr("x-1", Length)
list_item = ListItem(List=flatten(list), Index=list_length, Wrap=True)
offset = ClusterInput()
plane_offset = PlaneOffset(BasePlane=list_item, Offset=offset)
plane = ClusterOutput(plane_offset)

# ==== cluster Cluster_15
surface = ClusterInput()
curve = ClusterInput()
surface_2 = Surface(surface)
curve_2 = Curve(curve)
unit_z = UnitZ(Factor=1)
contour = Contour(Shape=surface_2, Point=Point(0, 0, 0), Direction=unit_z, Distance=Slider(3, range=0..10))
length = Length(Curve=curve_2)
curve_middle = CurveMiddle(Curve=contour)
end_points = EndPoints(Curve=contour)  # -> Start, End
vector_2pt = Vector2Pt(PointA=end_points.Start, PointB=end_points.End, Unitize=False)  # -> Vector, Length
negative = Negative(Value=vector_2pt.Vector)
line_sdl = LineSDL(Start=curve_middle, Direction=vector_2pt.Vector, Length=expr("x/2", length))
line_sdl_2 = LineSDL(Start=curve_middle, Direction=negative, Length=expr("x/2", length))
join_curves = JoinCurves(Curves=flatten([line_sdl_2, line_sdl]), Preserve=flatten(False))
curves = ClusterOutput(join_curves)

# ==== cluster Cluster_16
list = ClusterInput()
reverse_list = ReverseList(List=list)
relay = ClusterInput()
curve = Curve(reverse_list)

length = Length(Curve=curve)
end_points = EndPoints(Curve=curve)  # -> Start, End
negative = Negative(Value=relay)
curve_middle = CurveMiddle(Curve=curve)  # -> graft(Midpoint)
vector_2pt = Vector2Pt(PointA=end_points.Start, PointB=end_points.End, Unitize=False)  # -> graft(Vector), Length

delete_consecutive = DeleteConsecutive(Set=length, Wrap=False)  # -> Set, Count

multiplication = Multiplication(A=delete_consecutive.Set, B=[negative, relay])
amplitude = Amplitude(Vector=vector_2pt.Vector, Amplitude=multiplication)  # -> simplify(Vector)
move = Move(Geometry=simplify(curve_middle), Motion=amplitude)  # -> Geometry, Transform

move_to_point = MoveToPoint(Geometry=simplify(graft(curve)), PointA=simplify(curve_middle), PointB=move.Geometry)  # -> Moved, Vector, Transform
curve_2 = Curve(flatten(move_to_point.Moved))
curve_3 = Curve(simplify(graft(curve_2)))
curve_4 = ClusterOutput(curve_3)

# ==== cluster Cluster
i = ClusterInput()

number_slider = Slider(90, range=-180..180)
panel = Panel("""Gripper_open
Gripper_close""")
tool_weight = Panel("1")

mesh = Mesh([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])

rotate = Rotate(Geometry=mesh, Angle=degrees(number_slider), Plane=PlaneXY(0, 0, 0))  # -> Geometry, Transform

bbox = BoundingBox(Content=rotate.Geometry, Plane=PlaneXY(0, 0, 0))  # -> Box, Box_2
volume = Volume(Geometry=bbox.Box)  # -> Volume, Centroid
pline = PolyLine(Vertices=volume.Centroid, Closed=False)
midpt = CurveMiddle(Curve=pline)
xy = XYPlane(Origin=midpt)

gripper_open = Mesh([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])
gripper_close = Mesh([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])
mjoin = MeshJoin(Meshes=gripper_open)
mjoin_2 = MeshJoin(Meshes=gripper_close)
merge = Merge(Data1=mjoin, Data2=mjoin_2)

rotate_2 = Rotate(Geometry=merge, Angle=degrees(number_slider), Plane=PlaneXY(0, 0, 0))  # -> Geometry, Transform
rotate_3 = Rotate(Geometry=xy, Angle=degrees(number_slider), Plane=PlaneXY(0, 0, 0))  # -> Geometry, Transform

mesh_2 = Mesh(rotate_2.Geometry)

tool = CreateTool(Name=panel, TCP=rotate_3.Geometry, Weight=tool_weight, Mesh=mesh_2)  # -> Tool, TCP

# ----
# DDU_Schunk Gripper
tool_2 = ToolParameter(tool.Tool)

item = ListItem(List=tool_2, Index=i, Wrap=True)
tool_3 = ToolParameter(item)
tool_4 = ClusterOutput(tool_3)

# ==== cluster DisplayTCP
tcp_plane = ClusterInput()
tcp_plane_2 = Plane(graft(tcp_plane))
size = Number("60")
deconstruct_plane = DeconstructPlane(Plane=tcp_plane_2)  # -> Origin, XAxis, YAxis, ZAxis
division = Division(A=size, B="10")
colors = Panel("yellow")
merge = Merge(Data1=deconstruct_plane.XAxis, Data2=deconstruct_plane.YAxis, Data3=deconstruct_plane.ZAxis)
colors_2 = Panel("""red
green
blue""")
amplitude = Amplitude(Vector=merge, Amplitude=size)
symbol_simple = SymbolSimple(Style="5", Size=division, Rotation=0, Colour=colors)
symbol_display = SymbolDisplay(Location=tcp_plane_2, Display=symbol_simple)
vector_display_ex = VectorDisplayEx(Point=deconstruct_plane.Origin, Vector=amplitude, Colour=colors_2, Width=2)

# ==== cluster Cluster_10
base = ClusterInput()
value = ClusterInput()
negative = Negative(Value=value)
unit_z = UnitZ(Factor=negative)
extrude = Extrude(Base=base, Direction=unit_z)
surface = Surface(<surface referenced from the Rhino model>)
surface_2 = Surface(extrude)
dimensions = Dimensions(Surface=surface_2)  # -> UDimension, VDimension
division = Division(A=dimensions.UDimension, B=Slider(5, range=0..10))
divide_surface = DivideSurface(Surface=surface_2, UCount=division, VCount=Slider(1, range=0..1))  # -> Points, Normals, Parameters
flip_matrix = FlipMatrix(Data=divide_surface.Points)
panel = Panel("""0
1""")
explode_tree = ExplodeTree(Data=flip_matrix)  # -> _0000, _0001
weave = Weave(Pattern=panel, Stream0=explode_tree._0000, Stream1=explode_tree._0001, NullGaps=False)
point_list = PointList(Points=weave, Size=Slider(3, range=0..50))
weave_2 = ClusterOutput(weave)
